# Requirement set AUVReqs (R2020b)

## 1 [Underwater Vehicle Demo Requirements] References to Underwater Vehicle Demo Requirements.docx (Container)
Read-only references to Microsoft Word document.

### 1.1 [MissionSummary] Mission (Informational)
The mission for this vehicle is to search for a “black box” acoustic beacon on seafloor, navigate toward it, take a photo of the area to bring to surface, and report back with data on its estimated location
/
Figure 1: Whiteboard sketch of mission

### 1.2 [Functional_Requirements] Functional Requirements (Container)

#### 1.2.1 [Sensing_Requirements] Sensing (Container)

##### 1.2.1.1 [Sensing_EstimatePose] The system shall be capable of processing a combination of on-board sensors to estimate the pose of the underwater platform using either active or passive means

##### 1.2.1.2 [Sensing_AcousticBeacon] The system shall have on-board sensors capable of passively detecting an acoustic beacon signal

##### 1.2.1.3 [Sensing_ObstacleDetection] The system shall have onboard sensors capable of detecting obstacles in the underwater vehicle’s direct path

##### 1.2.1.4 [Sensing_CommandSys] The system shall be capable of receiving commands from and communicating with an acoustic command system

#### 1.2.2 [Perception_Requirements] Perception (Container)

##### 1.2.2.1 [Perception_UnderstandEnvironment] The platform shall create, in real-time, an understanding of the underwater environment, including… (Container)

###### 1.2.2.1.1 [Perception_Bathymetry] Bathymetry map of the sea floor

###### 1.2.2.1.2 [Perception_Currents] An understanding of the ocean currents

###### 1.2.2.1.3 [Perception_Obstacles] The existence and location of any solid obstacles in the direct path of the underwater vehicle

##### 1.2.2.2 [Perception_LocateBeaconNED] If an underwater acoustic beacon is detected, the system shall be capable of estimating the position of the beacon relative to the underwater vehicle platform in local (e.g. North, East, Down) coordinates

##### 1.2.2.3 [Perception_LocateBeaconECEF] If an underwater acoustic beacon is detected, the system shall be capable of estimating the position of the beacon in global (e.g., earth-centered, earth-fixed) coordinates via acoustic signal

##### 1.2.2.4 [Perception_TrackBeacon] The platform shall be capable of tracking the estimated position of the acoustic beacon over time

##### 1.2.2.5 [Perception_VisualizeBeacon] The system shall determine whether the beacon is visually apparent if imagery is available

#### 1.2.3 [Planning_Requirements] Planning (Container)

##### 1.2.3.1 [Planning_InitialSearch] The system shall be capable of using its understanding of the underwater vehicle platform pose and the environment to create an initial search pattern that minimizes power consumption

##### 1.2.3.2 [Planning_NavigatetoBeacon] When an underwater beacon is detected, the system shall be capable of path planning to navigate toward the beacon, avoiding any perceived obstacles, while minimizing power consumption

##### 1.2.3.3 [Planning_NavigateandSurface] The system shall be able to determine whether there is enough power to return to the surface with at least 30% battery power remaining.

##### 1.2.3.4 [Planning_AvoidObstacles] The underwater vehicle shall be capable of planning a navigation path around any obstacles that may be in the area of operation

##### 1.2.3.5 [Planning_ReturntoHome] The system shall be capable of planning a return-to-home path to a predefined user-requested location that minimizes power consumption

#### 1.2.4 [Action_Requirements] Action (Container)

##### 1.2.4.1 [Action_WaypointFollowing] The underwater vehicle shall autonomously navigate toward waypoints that are defined by the user or path planning algorithms

##### 1.2.4.2 [Action_SearchModePattern] The underwater vehicle shall run a search mode pattern until the expected battery level upon return to a designated home point is above a predefined threshold

##### 1.2.4.3 [Action_BeaconInterceptMission] If a beacon is detected and there is enough power available, the system shall alert the operator and run the Beacon Intercept mission

##### 1.2.4.4 [Action_AcceptCommand] If a beacon is detected and there is not enough power available to intercept, the system shall alert the operator and wait 10 minutes for a command before executing return-to-home sequence.

##### 1.2.4.5 [Action_BeaconInterceptEnd] The underwater vehicle shall run a Beacon Intercept mode until the expected battery level upon return to a designated home point is above a predefined threshold

##### 1.2.4.6 [Action_ImageScene] Once within camera range, the vehicle shall capture images of the scene and save to on-board storage for visual confirmation upon surfacing

##### 1.2.4.7 [Action_ReturntoHome] Once there is visual confirmation, the underwater vehicle shall alert the operator of the estimated location of the beacon and execute return-to-home sequence.

#### 1.2.5 [MissionAbort_Requirements] Mission Abort (Container)

##### 1.2.5.1 [MissionAbort_PathDeviation] The system shall detect significant deviation from the planned path and if necessary, run return-to-home (RTH) or return-to-surface (RTS) mission abort sequence

##### 1.2.5.2 [MissionAbort_HardwareFailure] When initiated by a hardware fault or failure, the system shall be able to run a return-to-home (RTH) or return-to-surface (RTS) abort sequence. Faults and failures and the sequence they initiate are defined in Table 1.
Table 1: Fault and Failure table and sequences to initiate
Fault/Failure Type
Fault/
Failure
Sequence to Initiate (return to surface or return to home)
Leak
Failure
RTS
10m deviation from path for 30 seconds
Fault
RTH
50m deviation from path for 30 seconds
Failure
RTS
Max Depth Threshold Exceeded
Failure
RTS
Internal temperature HIGH threshold exceeded
Fault
RTH
Internal temperature CRITICAL threshold exceeded
Failure
RTS
Low battery threshold exceeded
Fault
RTH
Critical battery threshold exceeded
Failure
RTS

##### 1.2.5.3 [MissionAbort_OperatorRequest] If requested by the operator, the system shall run a return-to-home (RTH) or return-to-surface (RTS) mission abort sequence

##### 1.2.5.4 [MissionAbort_StatusComms] The system shall communicate health and status (estimated location, battery, mode) to the user at a predefined interval when executing a mission abort sequence