test file "AUVTests"

suite "Power Consumption"

  case "Average Currents" [baseline]
    model AUV_ControlsPreliminary_PowerCalc
    parameter set "Parameter Set 1": currentadjust = 0.7  % model workspace
    pre-load callback:
      set_param('AUV_ControlsPreliminary_PowerCalc/Reference Trajectory/Reference Trajectory', 'ActiveScenario','StraightDive40');
    assessment "Assessment1": At any point of time, SoC must be greater than or equal to 0.3
      SoC: signal AUV_ControlsPreliminary_PowerCalc/Visualization/Power Consumption Calculation, port 1

  case "Strong Currents" [baseline]
    model AUV_ControlsPreliminary_PowerCalc
    parameter set "Parameter Set 1": currentadjust = 0.5  % model workspace
    pre-load callback: same code as in pre-load callback of case "Average Currents"
    assessment "Assessment1": At any point of time, SoC must be greater than or equal to 0.3
      SoC: signal AUV_ControlsPreliminary_PowerCalc/Visualization/Power Consumption Calculation, port 1

suite "Sensing and Perception"

  case "Pose Estimation" [baseline]
    model AUV_ControlsPreliminary_PowerCalc
    assessment "Assessment1": At any point of time, Signal must be greater than or equal to 0
      Signal: signal AUV_ControlsPreliminary_PowerCalc/Visualization/Power Consumption Calculation, port 1

  case "Acoustics" [baseline]
    model AUV_ControlsPreliminary_PowerCalc
    assessment "Assessment1": At any point of time, Signal must be greater than or equal to 0
      Signal: signal AUV_ControlsPreliminary_PowerCalc/Visualization/Power Consumption Calculation, port 1

  case "Obstacle Detection" [baseline]
    model AUV_ControlsPreliminary_PowerCalc
    assessment "Assessment1": At any point of time, Signal must be greater than or equal to 0
      Signal: signal AUV_ControlsPreliminary_PowerCalc/Visualization/Power Consumption Calculation, port 1

  case "Imagery" [baseline]
    model AUV_ControlsPreliminary_PowerCalc
    assessment "Assessment1": At any point of time, Signal must be greater than or equal to 0
      Signal: signal AUV_ControlsPreliminary_PowerCalc/Visualization/Power Consumption Calculation, port 1

suite "Path Planning"

  case "Search Path" [baseline]
    model AUV_ControlsPreliminary_PowerCalc
    assessment "Assessment1": At any point of time, Signal must be greater than or equal to 0
      Signal: signal AUV_ControlsPreliminary_PowerCalc/Visualization/Power Consumption Calculation, port 1

  case "Specific Goal Paths" [baseline]
    model AUV_ControlsPreliminary_PowerCalc
    assessment "Assessment1": At any point of time, Signal must be greater than or equal to 0
      Signal: signal AUV_ControlsPreliminary_PowerCalc/Visualization/Power Consumption Calculation, port 1

suite "Mission Aborts"

  case "Path Deviation" [baseline]
    model AUV_ControlsPreliminary_PowerCalc
    assessment "Assessment1": At any point of time, Signal must be greater than or equal to 0
      Signal: signal AUV_ControlsPreliminary_PowerCalc/Visualization/Power Consumption Calculation, port 1

  case "Hardware Failure" [baseline]
    model AUV_ControlsPreliminary_PowerCalc
    assessment "Assessment1": At any point of time, Signal must be greater than or equal to 0
      Signal: signal AUV_ControlsPreliminary_PowerCalc/Visualization/Power Consumption Calculation, port 1

  case "Operator Request" [baseline]
    model AUV_ControlsPreliminary_PowerCalc
    assessment "Assessment1": At any point of time, Signal must be greater than or equal to 0
      Signal: signal AUV_ControlsPreliminary_PowerCalc/Visualization/Power Consumption Calculation, port 1

  case "Status Communication" [baseline]
    model AUV_ControlsPreliminary_PowerCalc
    assessment "Assessment1": At any point of time, Signal must be greater than or equal to 0
      Signal: signal AUV_ControlsPreliminary_PowerCalc/Visualization/Power Consumption Calculation, port 1