% Requirement links of FunctionalArchitecture.slx (R2020b)

block :1 implements AUVReqs.slreqx#6: Sensing_AcousticBeacon: The system shall have on-board sensors capable of passively detecting an acoustic beacon signal
block :12 implements AUVReqs.slreqx#6: Sensing_AcousticBeacon: The system shall have on-board sensors capable of passively detecting an acoustic beacon signal
block :12 implements AUVReqs.slreqx#15: Perception_LocateBeaconECEF: If an underwater acoustic beacon is detected, the system shall be capable of estimating the position of the beacon in global (e.g., earth-centered, earth-fixed) coordinates via acoustic signal
block :14 implements AUVReqs.slreqx#20: Planning_NavigatetoBeacon: When an underwater beacon is detected, the system shall be capable of path planning to navigate toward the beacon, avoiding any perceived obstacles, while minimizing power consumption
block :19 implements AUVReqs.slreqx#21: Planning_NavigateandSurface: The system shall be able to determine whether there is enough power to navigate to the vicinity (10 meters) of the beacon and return to the surface with a predefined threshold of remaining battery
block :23 implements AUVReqs.slreqx#25: Action_WaypointFollowing: The underwater vehicle shall autonomously navigate toward waypoints that are defined by the user or path planning algorithms
block :4 implements AUVReqs.slreqx#5: Sensing_EstimatePose: The system shall be capable of processing a combination of on-board sensors to estimate the pose of the underwater platform using either active or passive means
block :5 implements AUVReqs.slreqx#7: Sensing_ObstacleDetection: The system shall have onboard sensors capable of detecting obstacles in the underwater vehicle’s direct path
block :50 implements AUVReqs.slreqx#33: MissionAbort_PathDeviation: The system shall detect significant deviation from the planned path and if necessary, run return-to-home (RTH) or return-to-surface (RTS) mission abort sequence