% Requirement links of LogicalArchitecture.slx (R2020b)

block :210 implements AUVReqs.slreqx#17: Perception_VisualizeBeacon: The system shall determine whether the beacon is visually apparent if imagery is available
block :212 implements AUVReqs.slreqx#21: Planning_NavigateandSurface: The system shall be able to determine whether there is enough power to navigate to the vicinity (10 meters) of the beacon and return to the surface with a predefined threshold of remaining battery
block :212 implements AUVReqs.slreqx#23: Planning_ReturntoHome: The system shall be capable of planning a return-to-home path to a predefined user-requested location that minimizes power consumption
block :212 implements AUVReqs.slreqx#26: Action_SearchModePattern: The underwater vehicle shall run a search mode pattern until the expected battery level upon return to a designated home point is above a predefined threshold
block :213 implements AUVReqs.slreqx#12: Perception_Currents: An understanding of the ocean currents
block :231 implements AUVReqs.slreqx#5: Sensing_EstimatePose: The system shall be capable of processing a combination of on-board sensors to estimate the pose of the underwater platform using either active or passive means
block :234 implements AUVReqs.slreqx#6: Sensing_AcousticBeacon: The system shall have on-board sensors capable of passively detecting an acoustic beacon signal
block :234 implements AUVReqs.slreqx#7: Sensing_ObstacleDetection: The system shall have onboard sensors capable of detecting obstacles in the underwater vehicle’s direct path
block :234 implements AUVReqs.slreqx#11: Perception_Bathymetry: Bathymetry map of the sea floor
block :234 implements AUVReqs.slreqx#13: Perception_Obstacles: The existence and location of any solid obstacles in the direct path of the underwater vehicle
block :234 implements AUVReqs.slreqx#14: Perception_LocateBeaconNED: If an underwater acoustic beacon is detected, the system shall be capable of estimating the position of the beacon relative to the underwater vehicle platform in local (e.g. North, East, Down) coordinates
block :234 implements AUVReqs.slreqx#15: Perception_LocateBeaconECEF: If an underwater acoustic beacon is detected, the system shall be capable of estimating the position of the beacon in global (e.g., earth-centered, earth-fixed) coordinates via acoustic signal
block :234 implements AUVReqs.slreqx#19: Planning_InitialSearch: The system shall be capable of using its understanding of the underwater vehicle platform pose and the environment to create an initial search pattern that minimizes power consumption
block :234 implements AUVReqs.slreqx#20: Planning_NavigatetoBeacon: When an underwater beacon is detected, the system shall be capable of path planning to navigate toward the beacon, avoiding any perceived obstacles, while minimizing power consumption
block :234 implements AUVReqs.slreqx#21: Planning_NavigateandSurface: The system shall be able to determine whether there is enough power to navigate to the vicinity (10 meters) of the beacon and return to the surface with a predefined threshold of remaining battery
block :234 implements AUVReqs.slreqx#22: Planning_AvoidObstacles: The underwater vehicle shall be capable of planning a navigation path around any obstacles that may be in the area of operation
block :234 implements AUVReqs.slreqx#23: Planning_ReturntoHome: The system shall be capable of planning a return-to-home path to a predefined user-requested location that minimizes power consumption
block :234 implements AUVReqs.slreqx#33: MissionAbort_PathDeviation: The system shall detect significant deviation from the planned path and if necessary, run return-to-home (RTH) or return-to-surface (RTS) mission abort sequence
block :234 implements AUVReqs.slreqx#34: MissionAbort_HardwareFailure: When initiated by a hardware fault or failure, the system shall be able to run a return-to-home (RTH) or return-to-surface (RTS) abort sequence. Faults and failures and the sequence they initiate are defined in Table 1.
block :234 implements AUVReqs.slreqx#35: MissionAbort_OperatorRequest: If requested by the operator, the system shall run a return-to-home (RTH) or return-to-surface (RTS) mission abort sequence
block :234 implements AUVReqs.slreqx#16: Perception_TrackBeacon: The platform shall be capable of tracking the estimated position of the acoustic beacon over time
block :234 implements AUVReqs.slreqx#29: Action_BeaconInterceptEnd: The underwater vehicle shall run a Beacon Intercept mode until the expected battery level upon return to a designated home point is above a predefined threshold
block :234 implements AUVReqs.slreqx#31: Action_ReturntoHome: Once there is visual confirmation, the underwater vehicle shall alert the operator of the estimated location of the beacon and execute return-to-home sequence.
block :240 implements AUVReqs.slreqx#25: Action_WaypointFollowing: The underwater vehicle shall autonomously navigate toward waypoints that are defined by the user or path planning algorithms
block :240 implements AUVReqs.slreqx#26: Action_SearchModePattern: The underwater vehicle shall run a search mode pattern until the expected battery level upon return to a designated home point is above a predefined threshold
block :240 implements AUVReqs.slreqx#27: Action_BeaconInterceptMission: If a beacon is detected and there is enough power available, the system shall alert the operator and run the Beacon Intercept mission
block :240 implements AUVReqs.slreqx#28: Action_AcceptCommand: If a beacon is detected and there is not enough power available to intercept, the system shall alert the operator and wait 10 minutes for a command before executing return-to-home sequence.
block :241 implements AUVReqs.slreqx#27: Action_BeaconInterceptMission: If a beacon is detected and there is enough power available, the system shall alert the operator and run the Beacon Intercept mission
block :241 implements AUVReqs.slreqx#30: Action_ImageScene: Once within camera range, the vehicle shall capture images of the scene and save to on-board storage for visual confirmation upon surfacing
block :406 implements AUVReqs.slreqx#8: Sensing_CommandSys: The system shall be capable of receiving commands from and communicating with an acoustic command system
block :406 implements AUVReqs.slreqx#35: MissionAbort_OperatorRequest: If requested by the operator, the system shall run a return-to-home (RTH) or return-to-surface (RTS) mission abort sequence
block :406 implements AUVReqs.slreqx#36: MissionAbort_StatusComms: The system shall communicate health and status (estimated location, battery, mode) to the user at a predefined interval when executing a mission abort sequence
block :406 implements AUVReqs.slreqx#27: Action_BeaconInterceptMission: If a beacon is detected and there is enough power available, the system shall alert the operator and run the Beacon Intercept mission
block :406 implements AUVReqs.slreqx#28: Action_AcceptCommand: If a beacon is detected and there is not enough power available to intercept, the system shall alert the operator and wait 10 minutes for a command before executing return-to-home sequence.