% Simulink data dictionary SignalInterfacesDD.sldd

MotorCmd = Simulink.Bus()
  HT1: double
  HT2: double
  VT1: double
  VT2: double
  MT1: double
  MT2: double

LocalizationLocalVars = Simulink.Bus()
  SpeedVector: double
  Depth: double
  Pose: double
  GPSLocation: double
  FusedLocation: double

TaskUpdateLocalVars = Simulink.Bus()
  ObstacleVector: double
  TargetStatus: double
  TargetLocation: double
  SearchParameter: double
  ReferencePath: double
  MappingParameters: double
  MappingData: double

SensData = Simulink.Bus()
  IMU: double
  DVL: double
  FoSo: double
  DoSo: double
  PaSo: double

AUVTx = Simulink.Bus()
  StatusMessage: double
  DataLog: double

AUVRx_Buoy1 = Simulink.Bus()
  GPS: double
  Command: double

AUVRx_Buoy2 = Simulink.Bus()
  GPS: double
  Command: double

AUVRx_Buoy3 = Simulink.Bus()
  GPS: double
  Command: double

AUVRx_Buoy4 = Simulink.Bus()
  GPS: double
  Command: double

CCTx = Simulink.Bus()
  Command: double

CCRx_Buoy1 = Simulink.Bus()
  StatusMessage: double
  GPS: double
  PowerStatus: double

CCRx_Buoy2 = Simulink.Bus()
  StatusMessage: double
  GPS: double
  PowerStatus: double

CCRx_Buoy3 = Simulink.Bus()
  StatusMessage: double
  GPS: double
  PowerStatus: double

CCRx_Buoy4 = Simulink.Bus()
  StatusMessage: double
  GPS: double
  PowerStatus: double